# Grasshopper definition CSharpWIP.gh (Grasshopper 0.9.76)

format = Format(Culture=127)
number_slider = Slider(1, range=0..1, expression="-x")
curve = Curve([<curve referenced from the Rhino model> x2])
curve_2 = Curve(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)
curve_3 = Curve(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)
number_slider_2 = Slider(9, range=0..19)
number_slider_3 = Slider(17, range=0..19)
number_slider_4 = Slider(180, range=0..360)
discontinuity = Discontinuity(Curve=curve, Level=1)  # -> Points, Parameters
curve_4 = Curve([<curve referenced from the Rhino model> x2])
c_script = CSharpScript(x=curve_4, y=Slider(9, range=0..100), z=Slider(50, range=0..100), u=Slider(100, range=0..100))  # -> out, A, B, C, D, E, F; inputs x: list of Curve, y: Int32, z: Int32, u: Int32
# ---------- c_script: C# ----------
    List<Curve> cur = x;

    Curve c = cur[0];
    Curve cO = cur[1];

    Point3d[] pointsA;
    Point3d[] pointsB;

    if(y == 0 || y == 1)
    {

      y = 2;

    }

    c.DivideByCount(y, true, out pointsA);
    cO.DivideByCount(y, true, out pointsB);

    if(z > y - 1)
    {

      z = y - 1;

    }

    if(z == 0)
    {

      z = 1;

    }

    if(u > y - 1)
    {

      u = y - 1;

    }

    Vector3d referencePoint = new Vector3d(pointsA[0]);
    Vector3d vO = new Vector3d(pointsA[u]);
    Point3d p = new Point3d(pointsB[z]);
    Vector3d vT = new Vector3d(p);

    vT -= vO;
    c.Translate(vT);

    Rhino.Geometry.Intersect.CurveIntersections ci;
    ci = Rhino.Geometry.Intersect.Intersection.CurveCurve(c, cO, 0.001, 0.001);
    Point3d[] intPtsO = new Point3d[ci.Count];

    for(int i = 0; i < ci.Count; i++)
    {

      intPtsO[i] = ci[i].PointA;

    }

    //List<Point3d> pt = new List<Point3d>();

    for( int i = 0; i < y; i++ )
    {

      //pt.Add(pointsA[i]);

      if(ci.Count > 1)
      {

        vO = new Vector3d(intPtsO[0]);
        p = pointsB[i];
        vT = new Vector3d(p);

        vT -= vO;
        c.Translate(vT);

        ci = Rhino.Geometry.Intersect.Intersection.CurveCurve(c, cO, 0.001, 0.001);
        intPtsO = new Rhino.Geometry.Point3d[ci.Count];

        for(int j = 0; j < ci.Count; j++)
        {

          intPtsO[j] = ci[j].PointA;

        }

      }

    }

    A = c;
    B = cO;
    C = p;
    D = intPtsO;
    E = pointsA;
# ---------- end c_script ----------
c_script_2 = CSharpScript(
    A=curve_2,
    B=curve_3,
    x=Slider(20, range=0..50),
    l=Slider(0, range=0..100),
    y=number_slider_2,
    z=number_slider_3,
    u=number_slider_4)  # -> out, AOut, APoints, BPoints, End, CurveA, CurveB, Intersect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; inputs A: Curve, B: Curve, x: Int32, l: Int32, y: Int32, z: Int32, u: Double
# ---------- c_script_2: C# ----------
    Curve a = A;
    Point3d[] pointsA;
    a.DivideByCount(x, true, out pointsA);

    Curve b = B;
    Point3d[] pointsB;
    b.DivideByCount(x, true, out pointsB);

    //End = b.PointAtEnd;


    if(l > x - 1)
    {

      l = (x - 1);
      outs = String.Format("l index is bigger than the size of the x collection");

    }

    /*
    List<Point3d> pointList = new List<Point3d>();
    for( int i = 0; i < pointsA.Length; i++ )
    {
      pointList.Add(pointsA[i]);
    }
    //foreach(Point3d point in pointList){}
    */

    Vector3d vec = new Vector3d(pointsB[l]);
    Vector3d one = new Vector3d(a.PointAtEnd);
    vec -= one;

    a.Translate(vec);

    CurveA = a;
    CurveB = b;

    Rhino.Geometry.Intersect.CurveIntersections ci;
    ci = Rhino.Geometry.Intersect.Intersection.CurveCurve(a, b, 0.001, 0.001);
    Point3d[] intPts = new Rhino.Geometry.Point3d[ci.Count];

    Point3d[] ptsA;
    a.DivideByCount(x, true, out ptsA);
    two = ptsA;

    End = a.PointAtEnd;

    for(int i = 0; i < ci.Count; i++)
    {

      intPts[i] = ci[i].PointA;

    }
    Intersect = intPts;

    if(ci.Count > 1)
    {


      Vector3d vO = new Vector3d(ptsA[z]);
      three = vO;
      Vector3d vT = new Vector3d(pointsB[y]);
      three = vT;
      vT -= vO;
      a.Translate(vT);

      /*
      Random r = new Random();
      foreach (int i in Enumerable.Range(0, 9).OrderBy(t => r.Next()))
      {
        four = i;
      }
      */

      /*
      List<Vector3d> pAList = new List<Vector3d>();
      Vector3d pA;
      List<Vector3d> pBList = new List<Vector3d>();
      Vector3d pB;
      */
      /*
      for(int i = 0; i < x; ++i)
      {

        //Vector3d[] p = new Vector3d[](ptsA[i]);
        //Vector3d[] pO = new Vector3d[](pointsB[j]);
        //p -= pO;
        //three = p;
        //a.Translate(p[1]);
        pA = new Vector3d(ptsA[i]);
        pB = new Vector3d(pointsB[i]);
        pAList.Add(pA);
        pBList.Add(pB);
        three = pAList;
        four = pBList;

      }
      */

      //a.Rotate(u * (Math.PI / 180), Vector3d.ZAxis, pointsB[y]);

      Rhino.Geometry.Intersect.CurveIntersections c;
      c = Rhino.Geometry.Intersect.Intersection.CurveCurve(a, b, 0.001, 0.001);
      Point3d[] intPtsO = new Rhino.Geometry.Point3d[c.Count];

      for(int i = 0; i < c.Count; i++)
      {

        intPtsO[i] = c[i].PointA;

      }
      IntersectTwo = intPtsO;
      four = c.Count;

      //Point3d p = new Point3d(ci[0].PointA);

      //Vector3d v = new Vector3d(p);

      /*
      Vector3d vO = new Vector3d(pointsA[l]);
      vec += vO;
      a.Translate(vec);
      */

      //Transform trans = Transform.Rotation(u, vec, ci[0].PointA);

      outs = String.Format("More than one collision");
      //oner = v;

    }

    else if( ci.Count == 1 )
    {

      outs = String.Format("Only one collision");

    }

    APoints = pointsA;
    BPoints = pointsB;
    AOut = String.Format(a + "\n" + b);
    //End = Counter();
# ---------- c_script_2: C# additional code ----------
  public Point3d Counter()
  {

    Point3d pt = new Point3d(1, 1, 1);
    return pt;

  }
# ---------- end c_script_2 ----------
c_script_3 = CSharpScript(x=curve, y=Slider(65.184, range=0..100), z=Slider(3, range=0..5))  # -> out, A, B, C, D, E; inputs x: list of Polyline, y: Double, z: Int32
# ---------- c_script_3: C# ----------
    List<Polyline> poly = x;

    var ptsA = new List<Point3d>();
    Polyline one = poly[1];
    ptsA = one.ToList();
    A = ptsA;

    var ptsB = new List<Point3d>();
    Polyline two = poly[0];
    ptsB = two.ToList();
    B = ptsB;

    Point3d ptA = ptsA[0];
    Point3d ptB = ptsB[z];

    Curve oneN = one.ToNurbsCurve();
    Vector3d vecA = new Vector3d(ptA);
    Vector3d vecB = new Vector3d(ptB);
    Vector3d fin = vecB - vecA;
    oneN.Translate(fin);
    C = oneN;

    Curve twoN = two.ToNurbsCurve();

    Rhino.Geometry.Intersect.CurveIntersections ci;
    ci = Rhino.Geometry.Intersect.Intersection.CurveCurve(oneN, twoN, 0.001, 0.001);
    Point3d[] intPtsO = new Rhino.Geometry.Point3d[ci.Count];

    for(int i = 0; i < ci.Count; i++)
    {

      intPtsO[i] = ci[i].PointA;

    }

    D = intPtsO;

    if(ci.Count > 1)
    {

      //oneN.DivideByCount();

      /*ptA = ptsA[1];
      vecA = new Vector3d(ptA);
      fin = vecB - vecA;
      oneN.Translate(fin);
      C = oneN;
      E = fin;
      */
    }
# ---------- end c_script_3 ----------
panel = Panel(c_script.F)
point = Point(c_script_3.A)
cull_index = CullIndex(List=point, Indices=number_slider, Wrap=True)
point_list = PointList(Points=cull_index)
panel_2 = Panel(cull_index)
partition_list = PartitionList(List=panel_2, Size=Slider(2, range=0..10))  # -> simplify(Chunks)
explode_tree = ExplodeTree(Data=partition_list)  # -> Branch0, Branch1
split_list = SplitList(List=cull_index, Index=Slider(2, range=0..10))  # -> ListA, ListB
point_2 = Point(split_list.ListB)
point_3 = Point(split_list.ListA)
panel_3 = Panel(partition_list)
list_item = ListItem(List=split_list.ListA, Index=Slider(0, range=0..1), Wrap=True)
list_item_2 = ListItem(List=explode_tree.Branch0, Index=Slider(0, range=0..100), Wrap=True)
list_item_3 = ListItem(List=split_list.ListA, Index=Slider(1, range=0..1), Wrap=True)
list_item_4 = ListItem(List=explode_tree.Branch0, Index=Slider(1, range=0..100), Wrap=True)
list_item_5 = ListItem(List=split_list.ListB, Index=Slider(1, range=0..1), Wrap=True)
list_item_6 = ListItem(List=partition_list, Index=Slider(0, range=0..100), Wrap=True)
list_item_7 = ListItem(List=split_list.ListB, Index=Slider(0, range=0..1), Wrap=True)
list_item_8 = ListItem(List=explode_tree.Branch1, Index=Slider(1, range=0..1), Wrap=True)
list_item_9 = ListItem(List=explode_tree.Branch1, Index=Slider(0, range=0..1), Wrap=True)
list_item_10 = ListItem(List=partition_list, Index=Slider(1, range=0..1), Wrap=True)
panel_4 = Panel(point)
point_4 = Point(list_item_2)
point_5 = Point(list_item_8)
point_6 = Point(list_item_6)
point_7 = Point(list_item_10)
point_8 = Point(list_item_4)
point_9 = Point(list_item_9)
vector_2pt = Vector2Pt(PointA=list_item_5, PointB=list_item, Unitize=False)  # -> Vector, Length
vector_2pt_2 = Vector2Pt(PointA=list_item_3, PointB=list_item_7, Unitize=False)  # -> Vector, Length
vector_2pt_3 = Vector2Pt(PointA=list_item_8, PointB=list_item_2, Unitize=False)  # -> Vector, Length
vector_2pt_4 = Vector2Pt(PointA=list_item_6, PointB=list_item_10, Unitize=False)  # -> Vector, Length
vector_2pt_5 = Vector2Pt(PointA=list_item_4, PointB=list_item_9, Unitize=False)  # -> Vector, Length
shift_list = ShiftList(List=panel_3, Shift=number_slider, Wrap=False)
vector_display = VectorDisplay(Anchor=list_item_5, Vector=vector_2pt.Vector)
vector_display_2 = VectorDisplay(Anchor=list_item_3, Vector=vector_2pt_2.Vector)
vector_display_3 = VectorDisplay(Anchor=list_item_8, Vector=vector_2pt_3.Vector)
vector_display_4 = VectorDisplay(Anchor=list_item_6, Vector=vector_2pt_4.Vector)
vector_display_5 = VectorDisplay(Anchor=list_item_4, Vector=vector_2pt_5.Vector)
panel_6 = Panel(shift_list)
point_10 = Point(c_script_3.B)
list_length = ListLength(List=point_10)
panel_7 = Panel(list_length)
list_item_11 = ListItem(List=point_10, Index=Slider(0, range=0..7), Wrap=True)
list_item_12 = ListItem(List=point_10, Index=Slider(1, range=0..7), Wrap=True)
list_item_13 = ListItem(List=point_10, Index=Slider(2, range=0..7), Wrap=True)
list_item_14 = ListItem(List=point_10, Index=Slider(1, range=0..7), Wrap=True)
list_item_15 = ListItem(List=point_10, Index=Slider(3, range=0..7), Wrap=True)
list_item_16 = ListItem(List=point_10, Index=Slider(2, range=0..7), Wrap=True)
list_item_17 = ListItem(List=point_10, Index=Slider(3, range=0..7), Wrap=True)
list_item_18 = ListItem(List=point_10, Index=Slider(4, range=0..7), Wrap=True)
list_item_19 = ListItem(List=point_10, Index=Slider(5, range=0..7), Wrap=True)
list_item_20 = ListItem(List=point_10, Index=Slider(4, range=0..7), Wrap=True)
list_item_21 = ListItem(List=point_10, Index=Slider(5, range=0..7), Wrap=True)
list_item_22 = ListItem(List=point_10, Index=Slider(6, range=0..7), Wrap=True)
curve_5 = Curve(c_script_3.C)
point_11 = Point(c_script_3.D)
point_12 = Point(c_script_3.E)
aoriginalpoints = Point(c_script_2.APoints)
boriginalpoints = Point(c_script_2.BPoints)
intersecttwo = Point(c_script_2.IntersectTwo)
intersectone = Point(c_script_2.Intersect)
pointanew = Point(c_script_2.two)
endpoints = Point(c_script_2.End)
curvea = Curve(c_script_2.CurveA)
panel_8 = Panel(c_script_2.oner)
curveb = Curve(c_script_2.CurveB)
point_13 = Point(c_script_2.three)
panel_9 = Panel(c_script_2.outs)
vector_2pt_6 = Vector2Pt(PointA=list_item_11, PointB=list_item_12, Unitize=False)  # -> Vector, Length
vector_2pt_7 = Vector2Pt(PointA=list_item_13, PointB=list_item_15, Unitize=False)  # -> Vector, Length
vector_2pt_8 = Vector2Pt(PointA=list_item_14, PointB=list_item_16, Unitize=False)  # -> Vector, Length
vector_2pt_9 = Vector2Pt(PointA=list_item_17, PointB=list_item_20, Unitize=False)  # -> Vector, Length
vector_2pt_10 = Vector2Pt(PointA=list_item_18, PointB=list_item_21, Unitize=False)  # -> Vector, Length
vector_2pt_11 = Vector2Pt(PointA=list_item_19, PointB=list_item_22, Unitize=False)  # -> Vector, Length
vector = Vector(c_script_2.oner)
panel_10 = Panel(endpoints)
panel_11 = Panel(intersectone)
panel_12 = Panel(intersecttwo)
panel_13 = Panel(pointanew)
panel_14 = Panel(c_script_2.three)
panel_15 = Panel(c_script_2.four)
A = Curve(c_script.A)
B = Curve(c_script.B)
C = Point(c_script.C)
D = Point(c_script.D)
E = Point(c_script.E)
partition_list_2 = PartitionList(List=point, Size="4")
panel_16 = Panel(partition_list_2)
vector_display_6 = VectorDisplay(Anchor=list_item_11, Vector=vector_2pt_6.Vector)
vector_display_7 = VectorDisplay(Anchor=list_item_13, Vector=vector_2pt_7.Vector)
vector_display_8 = VectorDisplay(Anchor=list_item_14, Vector=vector_2pt_8.Vector)
vector_display_9 = VectorDisplay(Anchor=list_item_17, Vector=vector_2pt_9.Vector)
vector_display_10 = VectorDisplay(Anchor=list_item_18, Vector=vector_2pt_10.Vector)
vector_display_11 = VectorDisplay(Anchor=list_item_19, Vector=vector_2pt_11.Vector)
point_list_2 = PointList(Points=point, Size=Slider(95.76, range=0..200))
bounding_box = BoundingBox(Content=curveb, Plane=PlaneXY(0, 0, 0))  # -> Box, Box_2
bounding_box_2 = BoundingBox(Content=curvea, Plane=PlaneXY(0, 0, 0))  # -> Box, Box_2
brep = Brep(curveb)
brep_2 = Brep(curvea)
number = Number(panel_15)
galapagos = Galapagos(fitness=addition, gene=[number_slider_2, number_slider_3, number_slider_4])
tree_branch = TreeBranch(Tree=partition_list_2, Path="{0;0;0}", MaintainPaths=True)
reverse_list = ReverseList(List=tree_branch)
panel_17 = Panel(reverse_list)
divide_curve = DivideCurve(Curve=curvea, Count=Slider(40, range=0..100), Kinks=False)  # -> Points, Tangents, Parameters
perp_frame = PerpFrame(Curve=curvea, Parameter=divide_curve.Parameters)
deconstruct_plane = DeconstructPlane(Plane=perp_frame)  # -> Origin, XAxis, YAxis, ZAxis
area = Area(Geometry=[bounding_box.Box, bounding_box_2.Box])  # -> Area, Centroid
curve_6 = Curve([<curve referenced from the Rhino model> x2])
line_sdl = LineSDL(Start=perp_frame, Direction=deconstruct_plane.YAxis, Length=Slider(100, range=0..100))
mass_addition = MassAddition(Input=area.Area)  # -> Result, PartialResults
c_script_4 = CSharpScript(x=curve_6)  # -> out, A, B, C; inputs x: list of Polyline
# ---------- c_script_4: C# ----------
    List<Polyline> poly = x;
    Polyline one = poly[1];
    List<Point3d> pts;
    pts = one.ToList();
    pts.RemoveAt(0);
    Point3d[] poi = pts.ToArray();
    Vector3d[] vec = new Vector3d[poi.Length];

    for(int i = 0; i < pts.Count; ++i)
    {

      vec[i] = new Vector3d(poi[i]);
    }

    A = pts;
    B = vec;
    C = pts;



    /*
    var ptsA = new List<Point3d>();
    Polyline one = poly[1];
    ptsA = one.ToList();
    ptsA.cu
    A = ptsA;
    */
# ---------- c_script_4: C# additional code ----------
  //private Rhino.Display.CustomDisplay m_display;
# ---------- end c_script_4 ----------
number_2 = Number(mass_addition.Result)
vector_2 = Vector(c_script_4.B)
point_14 = Point(c_script_4.A)
panel_18 = Panel(c_script_4.C)
panel_19 = Panel(vector_2)
point_list_3 = PointList(Points=point_14)
addition = Addition(A=number_2, B=number)
panel_20 = Panel(addition)
