# Grasshopper definition alpha_shapes.gh (Grasshopper 0.9.76)
# plug-ins: onScreen

pt = Point([<point referenced from the Rhino model> x7])
srf = Surface(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)
crv = Curve([<curve referenced from the Rhino model> x6])
popgeo = PopulateGeometry(Geometry=srf, Count=100, Seed=1)
divide = DivideCurve(Curve=crv, Count=50, Kinks=False)  # -> flatten(Points), Tangents, Parameters
del = DelaunayMesh(Points=divide.Points, Plane=PlaneXY(0, 0, 0))
alpha = AlphaShape(Points=pt, Radius=Slider(0, range=0..1), Plane=PlaneXY(0, 0, 0))
disc = Discontinuity(Curve=crv, Level=1)  # -> flatten(Points), Parameters
weld = WeldMesh(Mesh=del, Angle=3.141592654)
number_slider = Slider(10, range=0..10)
attrition = Slider(0.7, range=0..1)
facec = FaceCircles(Mesh=weld)  # -> Centers, Ratio
hull = ConvexHull(Points=divide.Points, Plane=PlaneXY(0, 0, 0))  # -> Hull, HullZ, Indices
demesh = DeconstructMesh(Mesh=weld)  # -> Vertices, Faces, Colours, Normals
darc = DeconstructArc(Arc=facec.Centers)  # -> BasePlane, Radius, Angle
sort = SortList(Keys=darc.Radius, ValuesA=demesh.Faces)  # -> Keys, ValuesA
lng = ListLength(List=demesh.Faces)
c_script = CSharpScript(x=divide.Points, y=number_slider)  # -> out, A; inputs x: list of Point3d, y: Int32
# ---------- c_script: C# ----------
    x.Reverse();
    
    var points = new List<Point3d>();

    var chunk = Chunk(x, y);

    var boolean = new List<bool>();

    foreach(var item in chunk)
    {

      item.Reverse();
      points = item.ToList();

    }

    A = points;
# ---------- c_script: C# additional code ----------
  public static IEnumerable<IEnumerable<T>> Chunk<T> (IEnumerable<T> source, int chunksize)
  {
    while (source.Any())
    {
      yield return source.Take(chunksize);
      source = source.Skip(chunksize);
    }
  }
# ---------- end c_script ----------
split = SplitList(List=divide.Points, Index=number_slider)  # -> ListA, ListB
multiplication = Multiplication(A=lng, B=attrition)
pt_2 = Point(split.ListA)
panel = Panel(c_script.A)
split_2 = SplitList(List=sort.ValuesA, Index=multiplication)  # -> ListA, ListB
panel_2 = Panel(split_2.ListA)
panel_3 = Panel(pt_2)
conmesh = ConstructMesh(Vertices=demesh.Vertices, Faces=split_2.ListA)
medges = MeshEdges(Mesh=conmesh)  # -> NakedEdges, InteriorEdges, NonManifoldEdges
equals = Equality(FirstNumber=panel_3, SecondNumber=panel)  # -> Equality, Inequality
join = JoinCurves(Curves=medges.NakedEdges, Preserve=False)
panel_4 = Panel(equals.Equality)
